vi "index.gviweb"   [G Web Development Software 22.0.0]
panel controls:
  "Pause": bool
panel indicators:
  "Temperatur": f64
  "temperatur graf": f64
  "hus": string
  "varme": string
  "Temperatur inne": f64
diagram:
  s1 = 10  # shift register
  s2 = 0  # shift register
  while {
    Increment(x=s2) -> w1
    case (w1) {
      frame 0, Default {
        w2 = 0.6
      }
      frame 1 {
        w2 = 0.9
      }
      frame 5 {
        w2 = 0.9
      }
      frame 6 {
        w2 = 0.8
      }
      frame 7 {
        w2 = 0.9
      }
      frame 40 {
        w2 = 0.5
      }
      frame 8 {
        w2 = 0.9
      }
      frame 9 {
        w2 = 0.8
      }
      frame 10 {
        w2 = 0.9
      }
      frame 11 {
        w2 = 0.5
      }
      frame 2 {
        w2 = 0.6
      }
      frame 3 {
        w2 = 0.6
      }
      frame 4 {
        w2 = 0.6
      }
      frame 12 {
        w2 = 0.4
      }
      frame 13 {
        w2 = 0.3
      }
      frame 14 {
        w2 = 0.4
      }
      frame 15 {
        w2 = 0.4
      }
      frame 16 {
        w2 = 0.4
      }
      frame 17 {
        w2 = 0.4
      }
      frame 18 {
        w2 = 0.4
      }
      frame 19 {
        w2 = 0.2
      }
      frame 20 {
        w2 = 0.2
      }
      frame 21 {
        w2 = 0.2
      }
      frame 22 {
        w2 = 0.1
      }
      frame 23 {
        w2 = 0.3
      }
      frame 24 {
        w2 = 0
      }
      frame 25 {
        w2 = 0
      }
      frame 26 {
        w2 = -0.2
      }
      frame 27 {
        w2 = -0.2
      }
      frame 28 {
        w2 = -0.2
      }
      frame 29 {
        w2 = -0.2
      }
      frame 30 {
        w2 = -0.2
      }
      frame 31 {
        w2 = -0.5
      }
      frame 32 {
        w2 = -0.4
      }
      frame 33 {
        w2 = -0.4
      }
      frame 34 {
        w2 = -0.4
      }
      frame 35 {
        w2 = -0.4
      }
      frame 36 {
        w2 = -0.1
      }
      frame 37 {
        w2 = -0.1
      }
      frame 38 {
        w2 = -0.1
      }
      frame 39 {
        w2 = -0.1
      }
    }
    Add(s1, w2) -> w3
    $"temperatur graf" <- w3
    $Temperatur <- w3
    $"Temperatur inne" <- w3
    Is Less(x=w1, y=39) -> w4
    case (w4) {
      frame False, Default {
        w5 = 0.2
      }
      frame True {
        w5 = 0
      }
    }
    Subtract(x=w3, y=w5) -> w6
    Is Less(x=s1, y=19) -> w7
    Property Node(instance in=reference to "varme", "Visible"=w7)
    Select(s=w4, t=w1, f=11) -> w8
    Wait(time to wait=500)
    case ($Pause) {
      frame False, Default { }
      frame True {
        while {
          Not(x=$Pause) -> w9
          stop if w9
        }
      }
    }
    next s1 = w6
    next s2 = w8
    stop if FALSE
  }
